# Grasshopper definition multiLayerArt.gh (Grasshopper 1.0.7)

# ---- group: Input curves
crv = Curve([<curve referenced from the Rhino model> x5])
cls = Closed(Curve=crv)  # -> Closed, Periodic
cull = CullPattern(List=crv, CullPattern=cls.Closed)
area = Area(Geometry=cull)  # -> Area, Centroid
larger = LargerThan(FirstNumber=area.Area, SecondNumber=Slider(10, range=0..2000))  # -> LargerThan, OrEqualTo
cull_2 = CullPattern(List=cull, CullPattern=larger.LargerThan)
number_slider = Slider(0, range=0..100)
cull_i = CullIndex(List=cull_2, Indices=number_slider, Wrap=True)
item = ListItem(List=cull_2, Index=number_slider, Wrap=True)
midpt = CurveMiddle(Curve=cull_i)
points = PointList(Points=midpt, Size=Slider(5, range=0..10))

# ---- group: Generate cutouts
frame_thickness = Slider(10, range=0..10)
boundary = BoundarySurfaces(Edges=item)
bbox = BoundingBox(Content=item, Plane=PlaneXY(0, 0, 0))  # -> Box, Box_2
offset = OffsetCurve(Curve=item, Distance=frame_thickness, Corners=1)
debox = DeconstructBox(Box=bbox.Box)  # -> Plane, X, Y, Z
number_slider_2 = Slider(0, range=0..10)
python = GhPythonScript(
    shapes=flatten(cull_i),
    outerFrame=offset,
    innerFrame=boundary,
    x=debox.X,
    y=debox.Y,
    groups="[[0], [1, 2]]",
    tabWidth=Slider(10, range=0..10))  # -> out, outlines, numLayer; inputs shapes: list
# ---------- python: Python ----------
"""Provides a scripting component.
    Inputs:
        shapes: list of curves in the image
        outerFrame: outer frame of the image (curve)
        innerFrame: inner frame of the image (srf)
        x: inner x dimension of the frame
        y: inner y dimension of the frame
        groups: list of lists specifying which shapes are in each layer, 
            the first in each of the inner list is the outermost shape of that layer
        tabWidth: width of the tabs connecting the shapes to the frame
    Output:
        outlines: outlines for each layer """

__author__ = "xiwe7299"

import rhinoscriptsyntax as rs
from Rhino.Geometry import AreaMassProperties, Line, Brep

def findCurveCentroid(guid):
    curve = rs.coercecurve(guid)
    return AreaMassProperties.Compute(curve).Centroid
    
def connectToClosestEdge(shape):
    edgeFrom = shape.closestEdge.From
    edgeTo = shape.closestEdge.To
    # edge is parallel to Y-axis 
    if edgeFrom[0] == edgeTo[0]:
        tab = rs.AddRectangle(rs.WorldXYPlane(), shape.distanceToClosestEdge, tabWidth)
        ToY = shape.centroid[1]
        ToX = (edgeFrom[0] + shape.centroid[0])/2
    # edge is parallel to X-axis
    else: 
        tab = rs.AddRectangle(rs.WorldXYPlane(), tabWidth, shape.distanceToClosestEdge)
        ToX = shape.centroid[0]
        ToY = (edgeFrom[1] + shape.centroid[1])/2
    translateVector = rs.VectorCreate((ToX, ToY, 0), findCurveCentroid(tab))
    movedTab = rs.CopyObject(tab, translateVector)

    return movedTab
    
class ShapeInFrame:
    def __init__(self, guid, boundingX, boundingY):
        self.guid = guid
        self.curve = rs.coercecurve(guid)
        amp = AreaMassProperties.Compute(self.curve)
        self.centroid = amp.Centroid
        self.closestEdge = None 
        self.distanceToClosestEdge = 0
        self.frameX = boundingX
        self.frameY = boundingY
        self.frameEdges = [
            Line(self.frameX.Min, self.frameY.Min, 0, self.frameX.Max, self.frameY.Min, 0), 
            Line(self.frameX.Min, self.frameY.Max, 0, self.frameX.Max, self.frameY.Max, 0), 
            Line(self.frameX.Min, self.frameY.Min, 0, self.frameX.Min, self.frameY.Max, 0), 
            Line(self.frameX.Max, self.frameY.Min, 0, self.frameX.Max, self.frameY.Max, 0)
            ]
    
    # returns distance to the edge closest to the centroid of the shape and this edge
    def findClosestEdge(self):
        smallestDist = 1000000
        cloesetEdge = None
        for e in self.frameEdges:
            dist = e.DistanceTo(self.centroid, False)
            if smallestDist >= dist:
                smallestDist = dist
                cloesetEdge = e
        self.closestEdge = cloesetEdge 
        self.distanceToClosestEdge = smallestDist
        return (smallestDist, cloesetEdge)
            
outlines = []

g = eval(groups)
# each group represent a layer
for group in g:
    outermostShape = ShapeInFrame(shapes[group[0]], x, y)
    outermostShape.findClosestEdge()
    tab = connectToClosestEdge(outermostShape)
    srf = rs.AddPlanarSrf([tab, outermostShape.guid])
    union = rs.BooleanUnion(srf)
    #layer = union + [shapes[i] for i in group[1:]]
    outlines += union
print(outlines)
numLayer = len(g)
# ---------- end python ----------
item_2 = ListItem(List=python.outlines, Index=number_slider_2, Wrap=True)
python_2 = GhPythonScript(shapes=flatten(cull_i), groups="[[0], [1, 2]]", layer=number_slider_2)  # -> out, currentLayer; inputs shapes: list, layer: Int32
# ---------- python_2: Python ----------
"""Provides a scripting component.
    Inputs:
        shapes: list of curves in the image
        groups: list of lists specifying which shapes are in each layer, 
            the first in each of the inner list is the outermost shape of that layer
        layer: index of the current layer
    Output:
        currentLayer: shapes for the current layer"""

__author__ = "xiwe7299"

import rhinoscriptsyntax as rs

currentLayer = []
g = eval(groups)
layerIndex = layer % len(g)

group = g[layerIndex]
currentLayer = [shapes[i] for i in group[1:]]

print(currentLayer)
# ---------- end python_2 ----------
rdiff = RegionDifference(CurvesA=boundary, CurvesB=item_2)
group = Group(Objects=[rdiff, offset, python_2.currentLayer])
